# Grasshopper definition cluster_github_test_v0.ghx (Grasshopper 0.9.14)

str = String()
str_2 = String(str)
split = StringSplit(String=str_2, Separators="#")
align = AlignPlanes()
dam = DataDam(DataA=split, BufferDelay=10000000, BufferMode=0)
flip = Flip(Surface=dam)  # -> Surface, Result
dispatch = Dispatch(List=split, DispatchPattern=[True, False])  # -> flatten(ListA), flatten(ListB)
col = Colour(dispatch.ListB)
geo = Geometry(dispatch.ListB)
col_2 = Colour(col)
geo_2 = Geometry(geo)
